# Dynamo graph EC2.dyn (Dynamo 3.6.1.9895)

file_path = Filename(".\EC-II.xlsx")
string = StringInput("Hoja1")
categories = Categories("OST_Walls")
all_elements_of_category = ElementsOfCategory(Category=categories)
python_script = Python(IN[0]=all_elements_of_category)  # CPython3
# ---------- python_script.python (50 lines) ----------
import clr
clr.AddReference('RevitServices')
import RevitServices
from RevitServices.Persistence import DocumentManager
 
clr.AddReference('RevitAPI')
from Autodesk.Revit.DB import *
 
doc = DocumentManager.Instance.CurrentDBDocument
 
# Desenvolver los elementos de Dynamo a elementos nativos de Revit
entrada = IN[0]
if not isinstance(entrada, list):
    entrada = [entrada]
elementos = [UnwrapElement(e) for e in entrada]
 
registros = []
 
for el in elementos:
    # Tipo de muro y su nombre
    tipo = doc.GetElement(el.GetTypeId())
    nombre_tipo = tipo.get_Parameter(BuiltInParameter.SYMBOL_NAME_PARAM).AsString()
 
    # Nivel base del muro
    nivel_el = doc.GetElement(el.LevelId)
    nivel = nivel_el.Name if nivel_el else None
 
    registros.append({
        "Id": el.Id.Value,
        "Nombre": nombre_tipo,
        "Nivel": nivel
    })
 
# Comillas simples por fuera porque el nombre incluye el símbolo " (pulgadas)
valores_validos = ['CC b = 50cm', 'CC b=0.35cm', 'CC b=50cm', 'PL-1 (e=13 cm)', 'PL-1 (e=25 cm)', 'PL-1 (e=23 cm)', 'PL-3 (e=25 cm)', 'PL-5 (e=25 cm)', 'PL-6 (e=25 cm)', 'PL-7 (e=25 cm)', 'PL-9 (e=25 cm)', 'PL-10 (e=25 cm)', 'PL-11 (e=25 cm)', 'PL-13 (e=25 cm)', 'Sobrecimiento b = 13cm', 'Sobrecimiento b = 23cm', 'Sobrecimiento Pre Mezclado Armado b = 13cm', 'Sobrecimiento Pre Mezclado Armado b = 23cm', 'MURO DE LADRILLO KK DE ARCILLA DE SOGA CM 1_4', 'MURO DE LADRILLO KK DE ARCILLA DE CABEZA CM 1_4', 'Parapeto b = 13cm']
 
for r in registros:
    nombre = r["Nombre"].strip() if r["Nombre"] else ""
    if nombre == "":
        r["Estado"] = "Falta parámetro"
    elif nombre not in valores_validos:
        r["Estado"] = "Fuera de estándar"
    else:
        r["Estado"] = "OK"
 
encabezados = ["Id", "Nombre", "Nivel", "Estado"]
filas = [[r["Id"], r["Nombre"], r["Nivel"], r["Estado"]]
         for r in registros]
 
OUT = [encabezados] + filas
# ----------------------------------------
watch = Watch(python_script)
openXMLExportExcel = Data.OpenXMLExportExcel(filePath=file_path, sheetName=string, data=watch)
